# Dynamo graph 01_Tyoe_複製.dyn (Dynamo 3.2.2.5494)

python_script = Python()  # CPython3; unwired: IN[0]
# ---------- python_script.python (24 lines) ----------
# 必要なライブラリをインポート
import clr
clr.AddReference('RevitServices')
from RevitServices.Persistence import DocumentManager
from RevitServices.Transactions import TransactionManager

clr.AddReference('RevitAPI')
from Autodesk.Revit.DB import *

# 現在のドキュメントを取得
doc = DocumentManager.Instance.CurrentDBDocument

# ファミリ名を格納するリスト
family_names = []

# 全てのファミリシンボルを取得
collector = FilteredElementCollector(doc).OfClass(Family)

for family in collector:
    # ファミリ名をリストに追加
    family_names.append(family.Name)

# OUTにファミリ名のリストを出力
OUT = family_names
# ----------------------------------------
python_script_2 = Python()  # CPython3; unwired: IN[0]
# ---------- python_script_2.python (31 lines) ----------
import clr
clr.AddReference("System.Windows.Forms")
from System.Windows.Forms import OpenFileDialog

import openpyxl  # 必要に応じてインストールしてください

# 1. ファイル選択ダイアログを開く
def open_file_dialog():
    dialog = OpenFileDialog()
    dialog.Filter = "Excel Files (*.xlsx)|*.xlsx"
    dialog.Multiselect = False  # 単一ファイルのみ選択可能
    if dialog.ShowDialog() == True:
        return dialog.FileName
    return None

# 2. Excelファイルを開いてシート一覧を取得
def get_excel_sheets(file_path):
    try:
        workbook = openpyxl.load_workbook(file_path, read_only=True)
        return workbook.sheetnames
    except Exception as e:
        return ["Error: " + str(e)]

# 3. Dynamoの出力
excel_file = open_file_dialog()  # ユーザーにファイルを選択させる
sheet_list = []

if excel_file:
    sheet_list = get_excel_sheets(excel_file)

OUT = excel_file, sheet_list
# ----------------------------------------
code_block = CodeBlock(x=python_script_2) { x[0]; }
code_block_2 = CodeBlock(x=python_script_2) { x[1]; }
python_script_3 = Python(IN[0]=code_block, IN[1]=code_block_2)  # CPython3
# ---------- python_script_3.python (73 lines) ----------
import clr
clr.AddReference("System.Windows.Forms")
from System.Windows.Forms import Form, ComboBox, Button, DialogResult, Label

import openpyxl  # 必要に応じてインストールしてください

# 1. シート選択画面を作成
def show_sheet_selector(sheet_names):
    form = Form()
    form.Text = "シート選択"
    form.Width = 300
    form.Height = 150

    label = Label()
    label.Text = "シート名を選択してください："
    label.Top = 10
    label.Left = 10
    label.Width = 260
    form.Controls.Add(label)

    combo = ComboBox()
    combo.Top = 40
    combo.Left = 10
    combo.Width = 260
    combo.DataSource = sheet_names
    form.Controls.Add(combo)

    ok_button = Button()
    ok_button.Text = "OK"
    ok_button.Top = 80
    ok_button.Left = 100
    ok_button.Width = 80

    def on_ok_click(sender, event):
        form.Tag = combo.SelectedItem  # 選択されたシート名を保存
        form.DialogResult = DialogResult.OK
        form.Close()

    ok_button.Click += on_ok_click
    form.Controls.Add(ok_button)

    if form.ShowDialog() == DialogResult.OK:
        return form.Tag  # 選択されたシート名を返す
    return None

# 2. 選択したシートの行・列情報を取得
def get_sheet_data(file_path, sheet_name):
    try:
        workbook = openpyxl.load_workbook(file_path, data_only=True)
        sheet = workbook[sheet_name]
        data = []
        for row in sheet.iter_rows(values_only=True):
            data.append(row)
        return data
    except Exception as e:
        return ["Error: " + str(e)]

# Dynamoからの入力 (OUTで受け取る想定)
excel_file = IN[0]  # Excelファイルのパス
sheet_list = IN[1]  # シート名のリスト

selected_sheet = None
sheet_data = []

if excel_file and sheet_list:
    # ユーザーがシートを選択
    selected_sheet = show_sheet_selector(sheet_list)
    if selected_sheet:
        # 選択されたシートのデータを取得
        sheet_data = get_sheet_data(excel_file, selected_sheet)

# Dynamoへの出力
OUT = selected_sheet, sheet_data
# ----------------------------------------
code_block_3 = CodeBlock(x=python_script_3) { x[1]; }
restOfItems = List.RestOfItems(list=code_block_3)
python_script_4 = Python(IN[0]=restOfItems)  # CPython3
# ---------- python_script_4.python (15 lines) ----------
# DynamoのINデータを取得
input_data = IN[0]

# 前のリストの0番目の値を保持する変数
previous_family_name = None

# null (None) を埋める処理
for sublist in input_data:
    if sublist[0] is None:  # 0番目の値がnullの場合
        sublist[0] = previous_family_name
    else:
        previous_family_name = sublist[0]  # 0番目がnullでない場合、値を保持

# 処理後のデータをOUTに出力
OUT = input_data
# ----------------------------------------
python_script_5 = Python(IN[0]=python_script, IN[1]=python_script_4)  # CPython3
# ---------- python_script_5.python (18 lines) ----------
# DynamoのINデータを取得
input_families = IN[0]  # Input1: 取得済みのファミリ名リスト
list_data = IN[1]  # 数字+List構造のデータ

# 結果を格納するリスト
included_lists = []  # Input1に含まれているファミリ名を持つリスト
excluded_lists = []  # Input1に含まれていないファミリ名を持つリスト

# データ構造を走査
for numbered_list in list_data:
    family_name = numbered_list[0]  # 各リストの0番目の値がファミリ名
    if family_name in input_families:
        included_lists.append(numbered_list)  # 含まれているリストに追加
    else:
        excluded_lists.append(numbered_list)  # 含まれていないリストに追加

# 結果をOUTに出力
OUT = (included_lists, excluded_lists)
# ----------------------------------------

# group: ファミリ作成が必要
# 説明<グループの説明を編集するにはここをダブル クリック>
code_block_4 = CodeBlock(x=python_script_5) { x[1]; }

python_script_6 = Python()  # CPython3; unwired: IN[0]
# ---------- python_script_6.python (26 lines) ----------
# 必要なライブラリをインポート
import clr
clr.AddReference('RevitServices')
from RevitServices.Persistence import DocumentManager
from RevitServices.Transactions import TransactionManager

clr.AddReference('RevitAPI')
from Autodesk.Revit.DB import *

# 現在のドキュメントを取得
doc = DocumentManager.Instance.CurrentDBDocument

# タイプ名を格納するリスト
type_names = []

# 全ての要素タイプを取得
collector = FilteredElementCollector(doc).WhereElementIsElementType()

for element_type in collector:
    # ElementTypeから名前を取得
    type_name = element_type.get_Parameter(BuiltInParameter.SYMBOL_NAME_PARAM).AsString()
    if type_name:  # 名前が空でない場合
        type_names.append(type_name)

# OUTにタイプ名のリストを出力
OUT = type_names
# ----------------------------------------
code_block_5 = CodeBlock(x=python_script_5) { x[0]; }
python_script_7 = Python(IN[0]=python_script_6, IN[1]=code_block_5)  # CPython3
# ---------- python_script_7.python (18 lines) ----------
# DynamoのINデータを取得
input_type_names = IN[0]  # Input1: 取得済みのタイプ名リスト
list_data = IN[1]  # 数字+List構造のデータ

# 結果を格納するリスト
included_lists = []  # Input1に含まれているタイプ名を持つリスト
excluded_lists = []  # Input1に含まれていないタイプ名を持つリスト

# データ構造を走査
for numbered_list in list_data:
    type_name = numbered_list[1]  # 各リストの1番目の値がタイプ名
    if type_name in input_type_names:
        included_lists.append(numbered_list)  # 含まれているリストに追加
    else:
        excluded_lists.append(numbered_list)  # 含まれていないリストに追加

# 結果をOUTに出力
OUT = (included_lists, excluded_lists)
# ----------------------------------------
code_block_6 = CodeBlock(x=python_script_7) { x[0]; }

# group: ファミリ・タイプあり
# 説明<グループの説明を編集するにはここをダブル クリック>
python_script_8 = Python(IN[0]=code_block_6)  # CPython3
# ---------- python_script_8.python (17 lines) ----------
# DynamoのPythonスクリプト
# IN[0]には構造ファイル(Listデータ構造)が入力されることを前提としています

# 入力データ
data = IN[0]

# ファミリ名を格納するリスト
family_names = []

# データ構造を走査し、"List > 数字 > 0" の値を取得
for list_item in data:
    if isinstance(list_item, list) and len(list_item) > 0:
        family_name = list_item[0]  # 各Listの最初の要素を取得
        family_names.append(family_name)

# 出力
OUT = family_names
# ----------------------------------------
python_script_9 = Python(IN[0]=code_block_6)  # CPython3
# ---------- python_script_9.python (17 lines) ----------
# DynamoのPythonスクリプト
# IN[0]には構造ファイル(Listデータ構造)が入力されることを前提としています

# 入力データ
data = IN[0]

# ファミリ名を格納するリスト
family_names = []

# データ構造を走査し、"List > 数字 > 0" の値を取得
for list_item in data:
    if isinstance(list_item, list) and len(list_item) > 0:
        family_name = list_item[1]  # 各Listの最初の要素を取得
        family_names.append(family_name)

# 出力
OUT = family_names
# ----------------------------------------

# group: Revit 内のタイプパラとインスタンスパラ(Excelデータより絞りこみ済)
# 説明<グループの説明を編集するにはここをダブル クリック>
python_script_10 = Python(IN[0]=python_script_8, IN[1]=python_script_9)  # CPython3
# ---------- python_script_10.python (43 lines) ----------
import clr
clr.AddReference("RevitServices")
from RevitServices.Persistence import DocumentManager
from Autodesk.Revit.DB import FilteredElementCollector, FamilyInstance

# 現在のドキュメントを取得
doc = DocumentManager.Instance.CurrentDBDocument

# IN[0] からファミリ名リストを取得
family_names = IN[0]  # Dynamo のノードから渡されるファミリ名のリスト
# IN[1] からタイプ名リストを取得
type_names = IN[1]    # Dynamo のノードから渡されるタイプ名のリスト

# 出力結果を格納するリスト
output_results = []

# ファミリインスタンスを取得
collector = FilteredElementCollector(doc).OfClass(FamilyInstance)

for element in collector:
    # ファミリ名を取得
    family_name = element.Symbol.Family.Name
    # タイプ名を取得
    type_name = element.Name
    
    # ファミリ名とタイプ名がリストに含まれているか確認
    if family_name in family_names and type_name in type_names:
        # パラメータを取得
        type_parameters = {param.Definition.Name: param.AsString() or param.AsValueString() 
                           for param in element.Symbol.Parameters}
        instance_parameters = {param.Definition.Name: param.AsString() or param.AsValueString() 
                               for param in element.Parameters}
        
        # 結果を格納
        output_results.append({
            "Family Name": family_name,
            "Type Name": type_name,
            "Type Parameters": type_parameters,
            "Instance Parameters": instance_parameters
        })

# Dynamo に結果を出力
OUT = output_results
# ----------------------------------------

python_script_11 = Python(IN[0]=python_script_8, IN[1]=python_script_9)  # CPython3
# ---------- python_script_11.python (48 lines) ----------
import clr
clr.AddReference("RevitServices")
from RevitServices.Persistence import DocumentManager
from Autodesk.Revit.DB import FilteredElementCollector, FamilyInstance

# 現在のドキュメントを取得
doc = DocumentManager.Instance.CurrentDBDocument

# IN[0] からファミリ名リストを取得
family_names = IN[0]  # Dynamo のノードから渡されるファミリ名のリスト
# IN[1] からタイプ名リストを取得
type_names = IN[1]    # Dynamo のノードから渡されるタイプ名のリスト

# 出力結果を格納する辞書
output_results = []

# ファミリインスタンスを取得
collector = FilteredElementCollector(doc).OfClass(FamilyInstance)

# 重複を避けるための記録用セット
seen = set()

for element in collector:
    # ファミリ名を取得
    family_name = element.Symbol.Family.Name
    # タイプ名を取得
    type_name = element.Name
    
    # ファミリ名とタイプ名がリストに含まれているか確認
    if family_name in family_names and type_name in type_names:
        # パラメータ名（項目名）のリストを取得
        type_parameter_names = sorted({param.Definition.Name for param in element.Symbol.Parameters})
        instance_parameter_names = sorted({param.Definition.Name for param in element.Parameters})
        
        # 重複を避けるためにファミリ名 + タイプ名でチェック
        key = (family_name, type_name)
        if key not in seen:
            seen.add(key)
            # 結果を格納
            output_results.append({
                "Family Name": family_name,
                "Type Name": type_name,
                "Type Parameters": type_parameter_names,
                "Instance Parameters": instance_parameter_names
            })

# Dynamo に結果を出力
OUT = output_results
# ----------------------------------------
code_block_7 = CodeBlock(x=python_script_7) { x[1]; }

# group: タイプ名未作成
# 説明<グループの説明を編集するにはここをダブル クリック>
python_script_12 = Python(IN[0]=code_block_7)  # CPython3; same code as python_script_8
python_script_13 = Python(IN[0]=code_block_7)  # CPython3; same code as python_script_9

python_script_14 = Python(IN[0]=python_script_12, IN[1]=python_script_13)  # CPython3
# ---------- python_script_14.python (52 lines) ----------
# Dynamoで必要なライブラリをインポート
import clr
clr.AddReference('RevitServices')
from RevitServices.Persistence import DocumentManager
from RevitServices.Transactions import TransactionManager

clr.AddReference('RevitAPI')
from Autodesk.Revit.DB import *

# Dynamo入力
family_names = IN[0]  # ファミリ名リスト (例: ["RC", "RC", "RC"])
type_names = IN[1]    # タイプ名リスト (例: ["1", "2", "3"])

# 現在のRevitドキュメントを取得
doc = DocumentManager.Instance.CurrentDBDocument

# 出力リスト
outputs = []

# トランザクションの開始
TransactionManager.Instance.EnsureInTransaction(doc)

try:
    # 入力リストの長さを確認
    if len(family_names) != len(type_names):
        raise Exception("ファミリ名とタイプ名のリストの長さが一致していません。")
    
    # 各ファミリ名とタイプ名のペアに対して処理を実行
    for family_name, type_name in zip(family_names, type_names):
        # ファミリシンボル（タイプ）のリストを取得
        collector = FilteredElementCollector(doc).OfClass(FamilySymbol)
        family_symbols = [fs for fs in collector if fs.Family.Name == family_name]
        
        if not family_symbols:
            outputs.append(f"指定されたファミリ '{family_name}' が見つかりません。")
            continue
        
        # 最初のタイプを基準に複製
        base_type = family_symbols[0]
        new_type = base_type.Duplicate(type_name)
        
        # 成功メッセージをリストに追加
        outputs.append(f"新しいタイプ '{type_name}' がファミリ '{family_name}' に作成されました。")

except Exception as e:
    outputs.append(f"エラー: {str(e)}")

# トランザクションの終了
TransactionManager.Instance.TransactionTaskDone()

# Dynamoに出力を渡す
OUT = outputs
# ----------------------------------------
