# Dynamo graph 01_element_確認.dyn (Dynamo 3.2.2.5494)

select_model_element = DSModelElementSelection()  # 1 picked in the model
python_script = Python(IN[0]=select_model_element)  # CPython3
# ---------- python_script.python (97 lines) ----------
import clr
clr.AddReference('RevitServices')
from RevitServices.Persistence import DocumentManager
from RevitServices.Transactions import TransactionManager

clr.AddReference('RevitAPI')
from Autodesk.Revit.DB import *

clr.AddReference('RevitNodes')
import Revit
clr.ImportExtensions(Revit.Elements)
clr.ImportExtensions(Revit.GeometryConversion)

# Revitの現在のドキュメントを取得
doc = DocumentManager.Instance.CurrentDBDocument

# 入力(IN[0])をリスト形式に変換（単一要素の場合にも対応）
input_elements = IN[0]
if not isinstance(input_elements, list):
    input_elements = [input_elements]

# Revit要素を取得（ElementIdか既に要素かを判定して処理）
selection = []
for item in input_elements:
    # Dynamo の入力要素が ElementWrapper の場合に対応
    element = UnwrapElement(item)
    if isinstance(element, Element):  # Revit 要素かどうかを確認
        selection.append(element)
    elif isinstance(element, ElementId):  # ElementId の場合
        selection.append(doc.GetElement(element))

# 出力リスト
output = []

for element in selection:
    element_data = {}
    
    # ファミリ名
    family = element.Symbol.Family if hasattr(element, "Symbol") and element.Symbol else None
    element_data["Family Name"] = family.Name if family else None
    
    # タイプ名
    element_data["Type Name"] = element.Name if element else None
    
    # カテゴリ
    category = element.Category
    element_data["Category"] = category.Name if category else None
    
    # カテゴリのパラメータ（GetParametersを使用）
    category_params = {}
    if category:
        try:
            for param in category.GetParameters():
                if param.StorageType == StorageType.String:
                    category_params[param.Definition.Name] = param.AsString()
                elif param.StorageType == StorageType.Double:
                    category_params[param.Definition.Name] = param.AsDouble()
                elif param.StorageType == StorageType.Integer:
                    category_params[param.Definition.Name] = param.AsInteger()
                elif param.StorageType == StorageType.ElementId:
                    category_params[param.Definition.Name] = param.AsElementId().ToString()
        except AttributeError:
            # カテゴリにパラメータがない場合はスキップ
            category_params = {}
    element_data["Category Parameters"] = category_params
    
    # インスタンスパラメータ
    instance_params = {}
    for param in element.Parameters:
        if param.StorageType == StorageType.String:
            instance_params[param.Definition.Name] = param.AsString()
        elif param.StorageType == StorageType.Double:
            instance_params[param.Definition.Name] = param.AsDouble()
        elif param.StorageType == StorageType.Integer:
            instance_params[param.Definition.Name] = param.AsInteger()
        elif param.StorageType == StorageType.ElementId:
            instance_params[param.Definition.Name] = param.AsElementId().ToString()
    element_data["Instance Parameters"] = instance_params
    
    # タイプパラメータ
    type_params = {}
    if hasattr(element, "Symbol") and element.Symbol:
        for param in element.Symbol.Parameters:
            if param.StorageType == StorageType.String:
                type_params[param.Definition.Name] = param.AsString()
            elif param.StorageType == StorageType.Double:
                type_params[param.Definition.Name] = param.AsDouble()
            elif param.StorageType == StorageType.Integer:
                type_params[param.Definition.Name] = param.AsInteger()
            elif param.StorageType == StorageType.ElementId:
                type_params[param.Definition.Name] = param.AsElementId().ToString()
    element_data["Type Parameters"] = type_params
    
    output.append(element_data)

# 出力
OUT = output
# ----------------------------------------
python_script_2 = Python(IN[0]=select_model_element)  # CPython3
# ---------- python_script_2.python (85 lines) ----------
import clr
clr.AddReference('RevitServices')
from RevitServices.Persistence import DocumentManager
from RevitServices.Transactions import TransactionManager

clr.AddReference('RevitAPI')
clr.AddReference('RevitAPIUI')
from Autodesk.Revit.DB import *

clr.AddReference('RevitNodes')
import Revit
clr.ImportExtensions(Revit.Elements)
clr.ImportExtensions(Revit.GeometryConversion)

# Revitの現在のドキュメントを取得
doc = DocumentManager.Instance.CurrentDBDocument

# Dynamoからの入力をリスト形式に変換（単一選択の場合も対応）
input_elements = IN[0]
if not isinstance(input_elements, list):
    input_elements = [input_elements]

# Revit要素を取得
selection = []
for item in input_elements:
    # Dynamoからの入力はラップされているのでUnwrapElementを使う
    try:
        element = UnwrapElement(item)
        if isinstance(element, Element):
            selection.append(element)
    except:
        pass  # 無効な入力があった場合はスキップ

# 出力リスト
output = []

for element in selection:
    element_data = {}

    try:
        # 基本情報
        element_data["Id"] = element.Id.IntegerValue
        element_data["Name"] = element.Name
        element_data["Category"] = element.Category.Name if element.Category else None

        # すべてのパラメータを取得
        parameters = {}
        for param in element.Parameters:
            try:
                if param.StorageType == StorageType.String:
                    parameters[param.Definition.Name] = param.AsString()
                elif param.StorageType == StorageType.Double:
                    parameters[param.Definition.Name] = param.AsDouble()
                elif param.StorageType == StorageType.Integer:
                    parameters[param.Definition.Name] = param.AsInteger()
                elif param.StorageType == StorageType.ElementId:
                    parameters[param.Definition.Name] = param.AsElementId().IntegerValue
            except Exception as e:
                parameters[param.Definition.Name] = str(e)
        element_data["Parameters"] = parameters

        # 型（Symbol）のパラメータも取得
        if hasattr(element, "Symbol") and element.Symbol:
            symbol_params = {}
            for param in element.Symbol.Parameters:
                try:
                    if param.StorageType == StorageType.String:
                        symbol_params[param.Definition.Name] = param.AsString()
                    elif param.StorageType == StorageType.Double:
                        symbol_params[param.Definition.Name] = param.AsDouble()
                    elif param.StorageType == StorageType.Integer:
                        symbol_params[param.Definition.Name] = param.AsInteger()
                    elif param.StorageType == StorageType.ElementId:
                        symbol_params[param.Definition.Name] = param.AsElementId().IntegerValue
                except Exception as e:
                    symbol_params[param.Definition.Name] = str(e)
            element_data["Type Parameters"] = symbol_params

    except Exception as e:
        element_data["Error"] = str(e)

    output.append(element_data)

# 出力
OUT = output
# ----------------------------------------
